% Simulink data dictionary polynomial_System.sldd

coeffA_t_squared = Simulink.Signal(StorageClass="ExportedGlobal", DataType="double", Min=0, Max=225, Unit="s^2")  % Coefficient A multiplied by the squared time term.
neg_4t = Simulink.Signal(StorageClass="ExportedGlobal", DataType="double", Min=-60, Max=0)  % -4 multiplied by time
t = Simulink.Signal(StorageClass="ExportedGlobal", DataType="double", Min=0, Max=15, Unit="s")
t_squared = Simulink.Signal(StorageClass="ExportedGlobal", DataType="double", Min=0, Max=225)  % Square of time
y = Simulink.Signal(StorageClass="ExportedGlobal", DataType="double", Min=17, Max=186)  % Polynomial output
y_raw = Simulink.Signal(StorageClass="ExportedGlobal", DataType="double", Min=17, Max=186)  % Intermediate polynomial result
COEFF_A = Simulink.Parameter(1, StorageClass="ExportedGlobal", DataType="double")  % Coefficient applied to the squared time term.
COEFF_B = Simulink.Parameter(-4, StorageClass="ExportedGlobal", DataType="double")  % Coefficient applied to the time term.
COEFF_C = Simulink.Parameter(21, StorageClass="ExportedGlobal", DataType="double")  % Constant offset applied to the polynomial equation.