# Requirement set 01_Polynomial_System (R2024a)
The software shall establish known initial values for all variables associated with Equation 1 at startup.

## 1 [SR-001] Software Requirements (Container)
<<NULL>>
Rationale: <<NULL>>

### 1.1 [HLR-001] Generate Time Signal
The software shall generate a time signal from 0.0 s to 15.0 s in increments of 0.25 sec.
Rationale: <<NULL>>

### 1.2 [HLR-002] Compute Polynomial
The software shall compute:
y = COEFF_A*(t^2) + COEFF_B*(t) + COEFF_C
where:
COEFF_A = 1
COEFF_B = -4
COEFF_C = 21
Rationale: <<NULL>>

### 1.3 [HLR-003] Store Y as Float
The software shall store y as a floating-point value.
Rationale: <<NULL>>

### 1.4 [HLR-004] Output Y
The software shall provide y at the output interface.
Rationale: <<NULL>>

## 2 [#6] Initial Conditions (Container)
<<NULL>>
Rationale: <<NULL>>

### 2.1 [HLR-005] Initialize Time Signal
The software shall initialize the time value to 0.0 seconds at startup.
Rationale: <<NULL>>

### 2.2 [HLR-006] Initialize Y Output
The software shall initialize y to 0.0 at startup.
Rationale: <<NULL>>