# Requirement set ch02_SystemRequirements (R2024a)

## 1 [SR-001] Equation 1 Calculation (Container)
The system shall generate output y according to:
y = (t^2) - 4(t) + 21
Rationale: <<NULL>>

### 1.1 [#2] Interface Requirements (Container)
The system shall generate output y according to:
y = (t^2) - 4(t) + 21
Rationale: <<NULL>>

#### 1.1.1 [IR-001] Time Input (Informational)
The system shall accept time t as an input represented in seconds.
Rationale: <<NULL>>

#### 1.1.2 [IR-002] Y Output (Informational)
The system shall provide y as an output.
Rationale: <<NULL>>

### 1.2 [#5] Functional Requirements (Container)
<<NULL>>
Rationale: <<NULL>>

#### 1.2.1 [FR-001] Calculate Y
The system shall calculate:
y = (t^2) - 4(t) + 21
Rationale: <<NULL>>

### 1.3 [#7] Initial Conditions (Container)
<<NULL>>
Rationale: <<NULL>>

#### 1.3.1 [IC-001] Initialize Time
At initialization, t shall equal 0.0 seconds.
Rationale: <<NULL>>

#### 1.3.2 [IC-002] Initialize Y
At initialization, y shall equal 0.0.
Rationale: <<NULL>>